# Grasshopper definition rammeprogram.gh (Grasshopper 0.9.76)
# plug-ins: Python Interpreter

# ---- group: Material Properties
expression = Expression(x=Slider(2.1, range=0..10), Expression="x*10^11")
num = Number([Slider(0.001, range=0..0.001), Slider(0.002, range=0..1)])
num_2 = Number(expression)
num_3 = Number(Slider(2e-06, range=0..1e-05))
python = PythonScript(Emodul=num_2, SecArea=num, Inertia=num_3)  # -> out, material, matMatLab; inputs Emodul: list, SecArea: list, Inertia: list
# ---------- python: Python ----------
if not (len(Emodul)==0 or len(SecArea)==0 or len(Inertia)==0):
    #Repeat last element in list to get equal list lenght
    maxlen = max(len(Emodul),len(SecArea),len(Inertia))
    SecArea.extend([SecArea[-1]]*(maxlen-len(SecArea)))
    Emodul.extend([Emodul[-1]]*(maxlen-len(Emodul)))
    Inertia.extend([Inertia[-1]]*(maxlen-len(Inertia)))
    
    
    matMatLab=""
    material=[]
    for i in range(len(Emodul)):
        mate="G("+str(i+1)+",:)=["+str(Emodul[i])+" "+str(SecArea[i])+" "+str(Inertia[i])+"];"
        material.append(mate)
        matMatLab=matMatLab+mate+"\n"
else:
    print "Zero length lists do NOT work"
# ---------- end python ----------
panel = Panel(python.out)
panel_2 = Panel(python.matMatLab)
panel_3 = Panel(python.material)

# ----
crv = Curve([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])
cluster = Cluster(C=crv)  # -> nodes, topolist
python_2 = PythonScript()  # -> out, elements; inputs topolist: list, nodes: list
# ---------- python_2: Python ----------
import rhinoscriptsyntax as rs
import scriptcontext
import Rhino
scriptcontext.doc = ghdoc
startpoint=[]
endpoint=[]
eleProp=[]
elements=[]

for topo in topolist:
    indices=str(rs.PointCoordinates(topo)).split(",")
    stpt=nodes[int(indices[0])]
    enpt=nodes[int(indices[1])]
    startpoint.append(stpt)
    endpoint.append(enpt)
    elements.append(rs.AddLine(stpt,enpt))
    #eleProp.append(nodes[indices[2]])
# ---------- end python_2 ----------
panel_4 = Panel(python_2.elements)

panel_5 = Panel("""0,1,0
1,2,0
2,3,0
3,4,0
4,5,0
5,6,0
6,7,0
7,8,0
8,9,0
9,10,0
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""")
panel_6 = Panel("""0,20
10,20
20,20
30,20
40,20
50,20
60,20
70,20
80,20
90,20
100,20
110,20
120,20
0,0
10,5.23
20,9.51
30,12.84
40,15.21
50,16.64
60,17.12
70,16.64
80,15.21
90,12.84
100,9.51
110,5.23
120,0""")
pt = Point(panel_5)
pt_2 = Point(panel_6)
pdecon = Deconstruct(Point=panel_5)  # -> XComponent, YComponent, ZComponent
panel_7 = Panel("""     14 11
14 2 0
                      14 6 0
                      26 1 0
                      26 2 0
                      1 2 0
                      7 1 0
                      13 2 0""")
int = Integer(pdecon.XComponent)
int_2 = Integer(pdecon.YComponent)
lng = ListLength(List=pt_2)
xy = XYPlane(Origin=pt_2)
bbox = BoundingBox(Content=pt_2, Plane=PlaneXY(0, 0, 0), UnionBox=True)  # -> Box, Box_2
item = ListItem(List=pt_2, Index=int, Wrap=True)
item_2 = ListItem(List=pt_2, Index=int_2, Wrap=True)
python_3 = PythonScript(topolist=pt, nodes=pt_2)  # -> out, elements; inputs topolist: list, nodes: list; same code as python_2
series = Series(Start=0, Step=1, Count=lng)
crv_2 = Curve(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)
crv_3 = Curve(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)
crv_4 = Curve(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)
area = Area(Geometry=bbox.Box)  # -> Area, Centroid
series_2 = Series(Start=0, Step=1, Count=10)
ln = Line(StartPoint=item, EndPoint=item_2)
merge = Merge(Data1=crv_2, Data2=crv_3, Data3=crv_4)
panel_8 = Panel("""14,1
14,2
14,3
26,1
26,2
1,2
7,1
13,2""")
int_3 = Integer(series)
division = Division(A=area.Area, B=1000)
scale = Scale(Geometry=merge, Center=Point(0, 0, 0), Factor=division)  # -> Geometry, Transform
tag = TextTag3D(Location=pt_2, Text=int_3, Size=division, Justification=7)

# ==== cluster Cluster
C = ClusterInput()

explode = Explode(Curve=flatten(C), Recursive=True)  # -> Segments, Vertices
eval = EvaluateCurve(Curve=reparameterize(explode.Segments), Parameter=0.5)  # -> Point, Tangent, Angle
sort_pt = SortPoints(Points=flatten(eval.Point))  # -> Points, Indices
tstat = TreeStatistics(Tree=eval.Point)  # -> Paths, Length, Count
item = ListItem(List=tstat.Paths, Index=sort_pt.Indices, Wrap=True)
branch = TreeBranch(Tree=explode.Segments, Path=item, MaintainPaths=False)
explode_2 = Explode(Curve=branch, Recursive=True)  # -> Segments, Vertices
sort_pt_2 = SortPoints(Points=flatten(explode_2.Vertices))  # -> Points, Indices
pdecon = Deconstruct(Point=sort_pt_2.Points)  # -> XComponent, YComponent, ZComponent
pt = ConstructPoint(XCoordinate=pdecon.XComponent, YCoordinate=pdecon.YComponent, ZCoordinate=0)
bbox = BoundingBox(Content=pt, Plane=PlaneXY(0, 0, 0), UnionBox=True)  # -> Box, Box_2
area = Area(Geometry=bbox.Box)  # -> Area, Centroid
division = Division(A=area.Area, B=1500)
cullpt = CullDuplicates(Points=pt, Tolerance=0.1, CullMode=3)  # -> Points, Indices, Valence
cp = ClosestPoint(Point=explode_2.Vertices, Cloud=cullpt.Points)  # -> ClosestPoint, CPIndex, Distance
eval_2 = EvaluateCurve(Curve=reparameterize(flatten(explode_2.Segments)), Parameter=0.5)  # -> Point, Tangent, Angle
item_2 = ListItem(List=cp.CPIndex, Index=0, Wrap=True)  # -> Item, Item1
points = PointList(Points=cullpt.Points, Size=division)
points_2 = PointList(Points=eval_2.Point, Size=division)
pt_2 = ConstructPoint(XCoordinate=item_2.Item, YCoordinate=item_2.Item1, ZCoordinate=0)  # -> flatten(Point)

nodes = ClusterOutput(cullpt.Points)  # Node coordinates
topolist = ClusterOutput(pt_2)  # Point where x is index of element startpoint and y end point
